# Grasshopper definition ░ó▓╝╘·▒╚(1)(2).gh (Grasshopper 1.0.7)
# plug-ins: Kangaroo2 Components, Vipers

# ---- group: 单独表皮结构
number_slider = Slider(93, range=0..100)  # disabled
number_slider_2 = Slider(151, range=0..1000)  # disabled
pt = ConstructPoint(XCoordinate=number_slider_2, YCoordinate=0, ZCoordinate=number_slider)  # disabled
六边形半径 = Slider(32, range=0..100)  # disabled
xz = XZPlane(Origin=pt)  # disabled
polygon = Polygon(Plane=xz, Radius=六边形半径, Segments=6, FilletRadius=0)  # -> Polygon, Length; disabled
disc = Discontinuity(Curve=polygon.Polygon, Level=1)  # -> Points, Parameters; disabled
ln = Line(StartPoint=disc.Points, EndPoint=pt)  # disabled
srfsplit = SurfaceSplit(Surface=polygon.Polygon, Curves=ln)  # disabled

# ---- group: 建筑造型+分三角 / 建筑椭圆长边
最小值 = Slider(39.44, range=0..100)
最大值 = Slider(54.04, range=0..100)
dom = ConstructDomain(DomainStart=最小值, DomainEnd=最大值)

# ---- group: 建筑造型+分三角 / 建筑椭圆短边
最小值_2 = Slider(26.95, range=0..100)
最大值_2 = Slider(40.2, range=0..100)
dom_2 = ConstructDomain(DomainStart=最小值_2, DomainEnd=最大值_2)

# ----
number_slider_3 = Slider(235, range=0..10000)  # disabled
pt_2 = ConstructPoint(XCoordinate=number_slider_3, YCoordinate=0, ZCoordinate=0)  # disabled
number_slider_4 = Slider(11, range=0..1000)  # disabled
xz_2 = XZPlane(Origin=pt_2)  # disabled
polygon_2 = Polygon(Plane=xz_2, Radius=number_slider_4, Segments=6, FilletRadius=0)  # -> Polygon, Length; disabled
explode = Explode(Curve=polygon_2.Polygon, Recursive=True)  # -> Segments, Vertices; disabled
area = Area(Geometry=polygon_2.Polygon)  # -> Area, Centroid; disabled
disc_2 = Discontinuity(Curve=polygon_2.Polygon, Level=1)  # -> Points, Parameters; disabled
midpt = CurveMiddle(Curve=explode.Segments)  # disabled
ln_2 = Line(StartPoint=midpt, EndPoint=area.Centroid)  # disabled
ln_3 = Line(StartPoint=disc_2.Points, EndPoint=area.Centroid)  # disabled
srfsplit_2 = SurfaceSplit(Surface=polygon_2.Polygon, Curves=ln_3)  # disabled
area_2 = Area(Geometry=srfsplit_2)  # -> Area, Centroid; disabled
midpt_2 = CurveMiddle(Curve=ln_2)  # disabled
dist = Distance(PointA=graft(midpt_2), PointB=area_2.Centroid)  # disabled
旋转角度 = Slider(37, range=0..100)  # disabled
sort = SortList(Keys=dist, ValuesA=srfsplit_2)  # -> Keys, ValuesA; disabled
item = ListItem(List=sort.ValuesA, Index=0, Wrap=True)  # disabled
srfsplit_3 = SurfaceSplit(Surface=item, Curves=graft(ln_2))  # disabled
半径 = Slider(0.36, range=0..10)  # disabled
neg = Negative(Value=旋转角度)  # disabled
rotax = RotateAxis(Geometry=srfsplit_3, Angle=degrees([neg, 旋转角度]), Axis=graft(ln_2))  # -> Geometry, Transform; disabled
pipe = Pipe(Curve=ln_2, Radius=半径, Caps=2)  # disabled
swatch = ColourSwatch(SwatchColor=RGB(163, 169, 255))  # disabled
swatch_2 = ColourSwatch(SwatchColor=RGB(161, 161, 161))  # disabled
preview = CustomPreview(Geometry=rotax.Geometry, Material=swatch)  # disabled
preview_2 = CustomPreview(Geometry=pipe, Material=swatch_2)  # disabled

number_slider_5 = Slider(136, range=0..1000)  # disabled
number_slider_6 = Slider(12, range=0..1000)  # disabled
pt_3 = ConstructPoint(XCoordinate=number_slider_5, YCoordinate=0, ZCoordinate=0)  # disabled
xz_3 = XZPlane(Origin=pt_3)  # disabled
polygon_3 = Polygon(Plane=xz_3, Radius=number_slider_6, Segments=6, FilletRadius=0)  # -> Polygon, Length; disabled
number_slider_7 = Slider(2, range=0..10)  # disabled
disc_3 = Discontinuity(Curve=polygon_3.Polygon, Level=1)  # -> Points, Parameters; disabled
partition = PartitionList(List=disc_3.Points, Size=number_slider_7)  # disabled
item_2 = ListItem(List=partition, Index=0, Wrap=True)  # disabled
ln_4 = Line(StartPoint=xz_3, EndPoint=item_2)  # -> flatten(Line); disabled
pline = PolyLine(Vertices=flatten(item_2), Closed=invert(False))  # disabled
srfsplit_4 = SurfaceSplit(Surface=polygon_3.Polygon, Curves=ln_4)  # disabled
explode_2 = Explode(Curve=pline, Recursive=True)  # -> graft(Segments), Vertices; disabled
旋转角度_2 = Slider(24, range=0..100)  # disabled
半径_2 = Slider(0.24, range=0..10)  # disabled
srfsplit_5 = SurfaceSplit(Surface=graft(srfsplit_4), Curves=explode_2.Segments)  # -> simplify(Fragments); disabled
neg_2 = Negative(Value=旋转角度_2)  # disabled
pipe_2 = Pipe(Curve=explode_2.Segments, Radius=半径_2, Caps=2)  # disabled
rotax_2 = RotateAxis(Geometry=srfsplit_5, Angle=degrees([neg_2, 旋转角度_2]), Axis=explode_2.Segments)  # -> Geometry, Transform; disabled
swatch_3 = ColourSwatch(SwatchColor=RGB(163, 169, 255))  # disabled
swatch_4 = ColourSwatch(SwatchColor=RGB(161, 161, 161))  # disabled
preview_3 = CustomPreview(Geometry=rotax_2.Geometry, Material=swatch_3)  # disabled
preview_4 = CustomPreview(Geometry=pipe_2, Material=swatch_4)  # disabled

number_slider_8 = Slider(184, range=0..1000)  # disabled
pt_4 = ConstructPoint(XCoordinate=number_slider_8, YCoordinate=0, ZCoordinate=0)  # disabled
number_slider_9 = Slider(11, range=0..1000)  # disabled
xz_4 = XZPlane(Origin=pt_4)  # disabled
polygon_4 = Polygon(Plane=xz_4, Radius=number_slider_9, Segments=6, FilletRadius=0)  # -> Polygon, Length; disabled
disc_4 = Discontinuity(Curve=polygon_4.Polygon, Level=1)  # -> Points, Parameters; disabled
explode_3 = Explode(Curve=polygon_4.Polygon, Recursive=True)  # -> Segments, Vertices; disabled
area_3 = Area(Geometry=polygon_4.Polygon)  # -> Area, Centroid; disabled
midpt_3 = CurveMiddle(Curve=explode_3.Segments)  # disabled
ln_5 = Line(StartPoint=midpt_3, EndPoint=area_3.Centroid)  # disabled
ln_6 = Line(StartPoint=disc_4.Points, EndPoint=area_3.Centroid)  # disabled
srfsplit_6 = SurfaceSplit(Surface=polygon_4.Polygon, Curves=ln_5)  # disabled
area_4 = Area(Geometry=srfsplit_6)  # -> Area, Centroid; disabled
midpt_4 = CurveMiddle(Curve=ln_6)  # disabled
旋转角度_3 = Slider(36, range=0..100)  # disabled
dist_2 = Distance(PointA=graft(midpt_4), PointB=area_4.Centroid)  # disabled
sort_2 = SortList(Keys=dist_2, ValuesA=srfsplit_6)  # -> Keys, ValuesA; disabled
item_3 = ListItem(List=sort_2.ValuesA, Index=0, Wrap=True)  # disabled
半径_3 = Slider(0.36, range=0..10)  # disabled
srfsplit_7 = SurfaceSplit(Surface=item_3, Curves=graft(ln_6))  # disabled
neg_3 = Negative(Value=旋转角度_3)  # disabled
rotax_3 = RotateAxis(Geometry=srfsplit_7, Angle=degrees([neg_3, 旋转角度_3]), Axis=graft(ln_6))  # -> Geometry, Transform; disabled
pipe_3 = Pipe(Curve=ln_6, Radius=半径_3, Caps=2)  # disabled
swatch_5 = ColourSwatch(SwatchColor=RGB(163, 169, 255))  # disabled
swatch_6 = ColourSwatch(SwatchColor=RGB(161, 161, 161))  # disabled
preview_5 = CustomPreview(Geometry=rotax_3.Geometry, Material=swatch_5)  # disabled
preview_6 = CustomPreview(Geometry=pipe_3, Material=swatch_6)  # disabled

# ---- group: 建筑造型+分三角 / 三角表皮uv方向细分数
u方向 = Slider(12, range=0..100)
v方向 = Slider(26, range=0..100)

# ---- group: 建筑造型+分三角
建筑高度 = Slider(234, range=0..1000)
number_slider_10 = Slider(27, range=0..100)
range = Range(Domain=Domain(0, 1), Steps=number_slider_10)
graph = GraphMapper(
    range,
    x0=0,
    x1=1,
    y0=0,
    y1=1,
    container_name="Bezier",
    cpx=[0, 0.3092947602, 0.6513981223, 1],
    cpy=[0, 0.2235748768, 0.2287192941, 0])
bnd = Bounds(Numbers=graph)
range_2 = Range(Domain=建筑高度, Steps=number_slider_10)
remap = RemapNumbers(Value=graph, Source=bnd, Target=dom)  # -> Mapped, Clipped
remap_2 = RemapNumbers(Value=graph, Source=bnd, Target=dom_2)  # -> Mapped, Clipped
pt_5 = ConstructPoint(XCoordinate=0, YCoordinate=0, ZCoordinate=range_2)
xy = XYPlane(Origin=pt_5)
表皮和建筑间隙 = Slider(3.769, range=0..100)
ellipse = Ellipse(Plane=xy, Radius1=remap.Mapped, Radius2=remap_2.Mapped)  # -> Ellipse, Focus1, Focus2
loft = Loft(Curves=ellipse.Ellipse, Options={Adjust=False, Closed=False, LoftEnds=0, LoftSimp=0, LoftType=0, Rebuild=10, Refit=0.01})
cluster = Cluster(A=v方向)
cluster_2 = Cluster(A=u方向)
offset = OffsetSurface(Surface=loft, Distance=expr("-x", 表皮和建筑间隙), Retrim=True)
sdivide = DivideSurface(Surface=offset, UCount=cluster_2, VCount=cluster)  # -> Points, Normals, Parameters
series = Series(Start=0, Step=1, Count=expr("x+1", cluster_2))  # -> reverse(graft(Series))
series_2 = Series(Start=0, Step=1, Count=expr("x+1", cluster_2))  # -> graft(Series)
shift = ShiftList(List=sdivide.Points, Shift=1, Wrap=False)
shift_2 = ShiftList(List=shift, Shift=series, Wrap=True)
shift_3 = ShiftList(List=shift, Shift=series_2, Wrap=True)
flip = FlipMatrix(Data=shift_2)
flip_2 = FlipMatrix(Data=shift_3)
number_slider_11 = Slider(2, range=0..10)
pline_2 = PolyLine(Vertices=flip, Closed=False)  # -> flatten(Polyline)
pline_3 = PolyLine(Vertices=flip_2, Closed=False)  # -> flatten(Polyline)
partition_2 = PartitionList(List=pline_2, Size=number_slider_11)
partition_3 = PartitionList(List=pline_3, Size=number_slider_11)
item_4 = ListItem(List=partition_2, Index=0, Wrap=True)
item_5 = ListItem(List=partition_3, Index=0, Wrap=True)
explode_4 = Explode(Curve=item_4, Recursive=True)  # -> Segments, Vertices
explode_5 = Explode(Curve=item_5, Recursive=True)  # -> Segments, Vertices
flip_3 = FlipMatrix(Data=explode_5.Segments)
flip_4 = FlipMatrix(Data=explode_4.Segments)
weave = Weave(Pattern=[0, 1], Stream0=flip_3, Stream1=flip_4, NullGaps=False)
item_6 = ListItem(List=ellipse.Ellipse, Index=0, Wrap=True)
midpt_5 = CurveMiddle(Curve=weave)
alongcrv = SortAlongCurve(Points=midpt_5, Curve=item_6)  # -> Points, Indices
item_7 = ListItem(List=weave, Index=alongcrv.Indices, Wrap=True)  # -> simplify(Item)
number_slider_12 = Slider(2, range=0..10)
lng = ListLength(List=item_7)
series_3 = Series(Start=0, Step=1, Count=lng)  # -> simplify(Series)
dup = DuplicateData(Data=series_3, Number=number_slider_12, Order=False)
shift_4 = ShiftList(List=dup, Shift=1, Wrap=True)
item_8 = ListItem(List=item_7, Index=shift_4, Wrap=True)
partition_4 = PartitionList(List=item_8, Size=number_slider_12)
loft_2 = Loft(Curves=partition_4, Options={Adjust=False, Closed=False, LoftEnds=0, LoftSimp=0, LoftType=0, Rebuild=10, Refit=0.01})

# ---- group: 单独表皮结构
crv = Curve(srfsplit)  # disabled
explode_6 = Explode(Curve=crv, Recursive=True)  # -> Segments, Vertices; disabled
area_5 = Area(Geometry=crv)  # -> Area, graft(Centroid); disabled
disc_5 = Discontinuity(Curve=crv, Level=1)  # -> Points, Parameters; disabled
midpt_6 = CurveMiddle(Curve=explode_6.Segments)  # disabled
ln_7 = Line(StartPoint=midpt_6, EndPoint=area_5.Centroid)  # disabled
srf_cp = SurfaceClosestPoint(Point=area_5.Centroid, Surface=graft(srfsplit))  # -> Point, UVPoint, Distance; disabled
ln_8 = Line(StartPoint=disc_5.Points, EndPoint=area_5.Centroid)  # disabled
开合距离 = Slider(2.99, range=0..10)  # disabled
end = EndPoints(Curve=ln_7)  # -> Start, End; disabled
evalsrf = EvaluateSurface(Surface=graft(srfsplit), Point=srf_cp.UVPoint)  # -> Point, Normal, UDirection, VDirection, Frame; disabled
pt_6 = Point(area_5.Centroid)  # disabled
pt_7 = Point(end.Start)  # disabled
end_2 = EndPoints(Curve=ln_8)  # -> Start, End; disabled
vec2pt = Vector2Pt(PointA=pt_7, PointB=area_5.Centroid, Unitize=False)  # -> Vector, Length; disabled
amp = Amplitude(Vector=vec2pt.Vector, Amplitude=开合距离)  # disabled
pt_8 = Point(end_2.Start)  # disabled
amp_2 = Amplitude(Vector=evalsrf.Normal, Amplitude=开合距离)  # disabled
move = Move(Geometry=pt_7, Motion=amp)  # -> Geometry, Transform; disabled
shift_5 = ShiftList(List=pt_8, Shift=1, Wrap=True)  # disabled
move_2 = Move(Geometry=pt_6, Motion=amp_2)  # -> Geometry, Transform; disabled
ln_9 = Line(StartPoint=move.Geometry, EndPoint=shift_5)  # -> simplify(Line); disabled
ln_10 = Line(StartPoint=pt_8, EndPoint=move.Geometry)  # -> simplify(Line); disabled
join = JoinCurves(Curves=[ln_9, ln_10], Preserve=False)  # disabled
extr = ExtrudePoint(Base=join, Point=move_2.Geometry)  # disabled
swatch_7 = ColourSwatch(SwatchColor=RGBA(134, 170, 189, 222))  # disabled
preview_7 = CustomPreview(Geometry=extr, Material=swatch_7)  # disabled

# ---- group: 玻璃加龙骨 / 玻璃uv方向数量
number_slider_13 = Slider(26, range=0..100)
number_slider_14 = Slider(50, range=0..100)

# ----
srf = Surface(loft)

# ---- group: 楼板
楼板间距 = Slider(8, range=0..100)
楼板 = Slider(0.2, range=0..1)
contour = Contour(Shape=srf, Point=Point(0, 0, 0), Direction=Vector(0, 0, 1), Distance=楼板间距)  # -> flatten(Contours)
boundary = BoundarySurfaces(Edges=contour)
Z = UnitZ(Factor=楼板)
extr_2 = Extrude(Base=boundary, Direction=Z)
preview_8 = CustomPreview(Geometry=extr_2, Material=ColourSwatch(SwatchColor=RGB(199, 199, 199)))  # disabled

# ---- group: 玻璃加龙骨
divide = DivideDomain²(Domain=loft, UCount=number_slider_13, VCount=number_slider_14)
框架半径 = Slider(0.12, range=0..1)
subsrf = Isotrim(Surface=loft, Domain=divide)
mp = MultiPipe(Curves=subsrf, NodeSize=框架半径, EndOffset=1, StrutSize=1, Segment=0, KinkAngle=0.6, CubeFit=0, Caps=0)
preview_9 = CustomPreview(Geometry=mp, Material=ColourSwatch(SwatchColor=RGB(112, 112, 112)))  # disabled
preview_10 = CustomPreview(Geometry=subsrf, Material=ColourSwatch(SwatchColor=RGBA(191, 220, 255, 209)))  # disabled

# ---- group: 单独表皮结构
骨架半径 = Slider(0.19, range=0..1)  # disabled
mp_2 = MultiPipe(Curves=ln_8, NodeSize=骨架半径, EndOffset=1, StrutSize=1, Segment=0, KinkAngle=0.6, CubeFit=0, Caps=1)  # disabled
swatch_8 = ColourSwatch(SwatchColor=RGB(148, 148, 148))  # disabled
preview_11 = CustomPreview(Geometry=mp_2, Material=swatch_8)  # disabled

# ----
计算层数 = Slider(14, range=0..100)
item_9 = ListItem(List=contour, Index=计算层数, Wrap=True)  # -> Item, Item1
divide_2 = DivideCurve(Curve=[item_9.Item, item_9.Item1], Count=Slider(38, range=0..100), Kinks=False)  # -> Points, Tangents, Parameters
pline_4 = PolyLine(Vertices=divide_2.Points, Closed=invert(False))
explode_7 = Explode(Curve=pline_4, Recursive=True)  # -> Segments, Vertices
bang = ExplodeTree(Data=explode_7.Segments)  # -> Branch0, Branch1
rulesrf = RuledSurface(CurveA=bang.Branch0, CurveB=bang.Branch1)
planar = IsPlanar(Surface=rulesrf, Interior=True)  # -> Planar, Plane
join_2 = BrepJoin(Breps=rulesrf)  # -> Breps, Closed
scale = Scale(Geometry=rulesrf, Center=planar.Plane, Factor=Slider(0.8, range=0..1))  # -> Geometry, Transform
cap = CapHoles(Brep=join_2.Breps)

# ---- group: 三角提取范围
number_slider_15 = Slider(3, range=0..100)
number_slider_16 = Slider(21, range=0..100)

# ---- group: 提取三角形 / 三角提取范围
number_slider_17 = Slider(3, range=0..100)
number_slider_18 = Slider(20, range=0..100)

# ---- group: 三角每圈提取数量
number_slider_19 = Slider(21, range=0..100)
number_slider_20 = Slider(2, range=0..100)

# ----
hexagons = 六边形网格(曲面=offset, U方向数量=Slider(12, range=0..100), V方向数量=Slider(24, range=0..100))  # -> 网格, 网格点
tstat = TreeStatistics(Tree=hexagons.网格)  # -> Paths, Length, Count
dom_3 = ConstructDomain(DomainStart=number_slider_15, DomainEnd=number_slider_16)
subset = SubList(List=tstat.Paths, Domain=dom_3, Wrap=True)  # -> List, Index
branch = TreeBranch(Tree=hexagons.网格, Path=subset.List, MaintainPaths=True)
dom_4 = ConstructDomain(DomainStart=number_slider_20, DomainEnd=number_slider_19)
subset_2 = SubList(List=branch, Domain=dom_4, Wrap=True)  # -> flatten(List), Index
disc_6 = Discontinuity(Curve=subset_2.List, Level=1)  # -> Points, Parameters
avr = Average(Input=disc_6.Points)

# ---- group: 提取三角形 / 三角每圈提取数量
number_slider_21 = Slider(46, range=0..100)
number_slider_22 = Slider(4, range=0..100)

# ---- group: 提取三角形
trim = TrimTree(Tree=loft_2, Depth=1)
tstat_2 = TreeStatistics(Tree=trim)  # -> Paths, Length, Count
dom_5 = ConstructDomain(DomainStart=number_slider_17, DomainEnd=number_slider_18)
subset_3 = SubList(List=tstat_2.Paths, Domain=dom_5, Wrap=True)  # -> List, Index
branch_2 = TreeBranch(Tree=trim, Path=subset_3.List, MaintainPaths=True)
dom_6 = ConstructDomain(DomainStart=number_slider_22, DomainEnd=number_slider_21)
subset_4 = SubList(List=branch_2, Domain=dom_6, Wrap=True)  # -> List, Index

# ----
analysisperiod = LBAnalysisPeriod(start_month=1, start_day=1, start_hour=Slider(16, range=0..100), end_hour=Slider(17, range=0..100))  # -> period, hoys, dates; plug-in component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
flip_5 = FlipCurve(Curve=subset_2.List)  # -> Curve, Flag
srf_2 = Surface(flatten(subset_4.List))
extr_3 = ExtrudePoint(Base=graft(flip_5.Curve), Point=avr)
graft = GraftTree(Tree=srf_2, IncludeEmptyLists=True, IncludeNullItems=True)

# ---- group: 开合表皮
crv_2 = Curve(graft)
explode_8 = Explode(Curve=crv_2, Recursive=True)  # -> Segments, Vertices
area_6 = Area(Geometry=crv_2)  # -> Area, graft(Centroid)
midpt_7 = CurveMiddle(Curve=explode_8.Segments)
disc_7 = Discontinuity(Curve=crv_2, Level=1)  # -> Points, Parameters
ln_11 = Line(StartPoint=disc_7.Points, EndPoint=area_6.Centroid)
ln_12 = Line(StartPoint=midpt_7, EndPoint=area_6.Centroid)
srf_cp_2 = SurfaceClosestPoint(Point=area_6.Centroid, Surface=graft(graft))  # -> Point, UVPoint, Distance
end_3 = EndPoints(Curve=ln_12)  # -> Start, End
end_4 = EndPoints(Curve=ln_11)  # -> Start, End
evalsrf_2 = EvaluateSurface(Surface=graft(graft), Point=srf_cp_2.UVPoint)  # -> Point, Normal, UDirection, VDirection, Frame
pt_9 = Point(end_3.Start)
pt_10 = Point(end_4.Start)
relay = Relay()
vec2pt_2 = Vector2Pt(PointA=pt_9, PointB=area_6.Centroid, Unitize=False)  # -> Vector, Length
pt_11 = Point(area_6.Centroid)
shift_6 = ShiftList(List=pt_10, Shift=1, Wrap=True)
amp_3 = Amplitude(Vector=vec2pt_2.Vector, Amplitude=relay)
amp_4 = Amplitude(Vector=evalsrf_2.Normal, Amplitude=relay)
move_3 = Move(Geometry=pt_9, Motion=amp_3)  # -> Geometry, Transform
move_4 = Move(Geometry=pt_11, Motion=amp_4)  # -> Geometry, Transform
ln_13 = Line(StartPoint=move_3.Geometry, EndPoint=shift_6)  # -> simplify(Line)
ln_14 = Line(StartPoint=pt_10, EndPoint=move_3.Geometry)  # -> simplify(Line)
join_3 = JoinCurves(Curves=[ln_13, ln_14], Preserve=False)
extr_4 = ExtrudePoint(Base=join_3, Point=move_4.Geometry)
preview_12 = CustomPreview(Geometry=extr_4, Material=ColourSwatch(SwatchColor=RGB(230, 174, 106)))  # disabled

# ---- group: 计算开关
toggle = BooleanToggle(True)

# ---- group: 开合移动区间距离
number_slider_23 = Slider(2.4, range=0..10)
number_slider_24 = Slider(0.8, range=0..10)

# ---- group: 拾取气候文件
path = FilePath("C:\Users\lipengfei\Desktop\000\CHN_YN_Xishuangbanna-Jinghong.569590_TMYx.2004-2018.epw")
wea = HBWeaFromEPW(epw_file=path)  # -> wea; plug-in component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

# ---- group: 表皮支撑架
支撑架半径 = Slider(0.18, range=0..1)
mp_3 = MultiPipe(Curves=flatten(ln_11), NodeSize=支撑架半径, EndOffset=1, StrutSize=1, Segment=0, KinkAngle=0.6, CubeFit=0, Caps=1)
preview_13 = CustomPreview(Geometry=mp_3, Material=ColourSwatch(SwatchColor=RGB(148, 148, 148)))  # disabled

# ---- group: 开始计算
toggle_2 = BooleanToggle(True)

# ----
geo = Geometry(cap)
geo_2 = Geometry(scale.Geometry)
aperture = HBAperture(geo=geo_2, name="窗户")  # -> report, apertures; plug-in component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
face = HBFace(geo=geo, name="房间")  # -> report, faces; plug-in component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
addsubface = HBAddSubface(hb_obj=flatten(face.faces), sub_faces=flatten(aperture.apertures))  # -> hb_obj; plug-in component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
# 通过honeybee开合范围值影响室内接收光照强度，从而达到室内合理的亮度。
room = HBRoom(faces=flatten(addsubface), conditioned=Toggle(True))  # -> report, room; plug-in component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
墙厚 = Slider(0.25, range=0..1)
bordershades = HBExtrudedBorderShades(hb_objs=flatten(room.room), depth=墙厚)  # -> report, hb_objs; plug-in component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
模型计算精细程度 = Slider(2, range=0..10)
recipesettings = HBRecipeSettings(reload_old=False)  # -> settings; plug-in component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
legendpar = LBLegendParameters(min=Slider(0, range=0..100), max=Slider(100, range=0..100))  # -> leg_par; plug-in component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

# ----
# ladybug控制整体开合大小
path_2 = FilePath("C:\Users\lipengfei\Desktop\000\CHN_YN_Xishuangbanna-Jinghong.569590_TMYx.2004-2018.epw")
importepw = LBImportEPW(epw_file=path_2)  # -> location, dry_bulb_temperature, dew_point_temperature, relative_humidity, wind_speed, wind_direction, direct_normal_rad, diffuse_horizontal_rad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; plug-in component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
graft_2 = GraftTree(Tree=extr_3, IncludeEmptyLists=True, IncludeNullItems=True)  # -> simplify(Tree)
smesh = SimpleMesh(Brep=graft_2)
skymatrix = LBCumulativeSkyMatrix(
    north="20",
    location=importepw.location,
    direct_rad=importepw.direct_normal_rad,
    diffuse_rad=importepw.diffuse_horizontal_rad,
    hoys=analysisperiod.hoys)  # -> report, sky_mtx; plug-in component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
计算网格单元 = Slider(200, range=0..1000)
dom_7 = ConstructDomain(DomainStart=number_slider_23, DomainEnd=number_slider_24)

# ---- group: 房屋辐射
geo_3 = Geometry(smesh)

# ----
# 辐射
incidentradiation = LBIncidentRadiation(sky_mtx=skymatrix.sky_mtx, geometry=flatten(geo_3), grid_size=计算网格单元, offset_dist="0.1", run=toggle)  # -> report, points, results, total, mesh, legend, title, int_mtx; plug-in component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

mesh = Mesh(incidentradiation.mesh)
geo_4 = Geometry(incidentradiation.legend)
bnd_2 = Bounds(Numbers=incidentradiation.results)
remap_3 = RemapNumbers(Value=incidentradiation.results, Source=bnd_2, Target=dom_7)  # -> Mapped, Clipped

partition_5 = PartitionList(List=remap_3.Mapped, Size=Slider(6, range=0..10))
avr_2 = Average(Input=partition_5)
multiplication = Multiplication(A=avr_2, B=Slider(28, range=0..100))

# ---- group: 新表皮2
pt_12 = ConstructPoint(XCoordinate=Slider(184, range=0..1000), YCoordinate=0, ZCoordinate=0)
xz_5 = XZPlane(Origin=pt_12)
polygon_5 = Polygon(Plane=xz_5, Radius=Slider(11, range=0..1000), Segments=6, FilletRadius=0)  # -> Polygon, Length
disc_8 = Discontinuity(Curve=polygon_5.Polygon, Level=1)  # -> Points, Parameters
explode_9 = Explode(Curve=subset_2.List, Recursive=True)  # -> Segments, Vertices
area_7 = Area(Geometry=polygon_5.Polygon)  # -> Area, Centroid
midpt_8 = CurveMiddle(Curve=explode_9.Segments)
ln_15 = Line(StartPoint=disc_6.Points, EndPoint=avr)
ln_16 = Line(StartPoint=midpt_8, EndPoint=avr)
shift_7 = ShiftList(List=ln_15, Shift=1, Wrap=True)
number_slider_25 = Slider(2, range=0..10)
number_slider_26 = Slider(2, range=0..10)
weave_2 = Weave(Pattern=[0, 1], Stream0=ln_15, Stream1=ln_16, NullGaps=False)
weave_3 = Weave(Pattern=[0, 1], Stream0=ln_16, Stream1=shift_7, NullGaps=False)
partition_6 = PartitionList(List=weave_2, Size=number_slider_25)
partition_7 = PartitionList(List=weave_3, Size=number_slider_26)
loft_3 = Loft(Curves=partition_7, Options={Adjust=False, Closed=False, LoftEnds=0, LoftSimp=0, LoftType=0, Rebuild=10, Refit=0.01})  # -> simplify(Loft)
loft_4 = Loft(Curves=partition_6, Options={Adjust=False, Closed=False, LoftEnds=0, LoftSimp=0, LoftType=0, Rebuild=10, Refit=0.01})
旋转角度_4 = Slider(36, range=0..100)
trim_2 = TrimTree(Tree=loft_3, Depth=1)
trim_3 = TrimTree(Tree=loft_4, Depth=1)
neg_4 = Negative(Value=multiplication)
rotax_4 = RotateAxis(Geometry=trim_3, Angle=degrees(multiplication), Axis=ln_16)  # -> Geometry, Transform
rotax_5 = RotateAxis(Geometry=trim_2, Angle=degrees(neg_4), Axis=ln_16)  # -> Geometry, Transform
srf_3 = Surface(flatten([rotax_5.Geometry, rotax_4.Geometry]))
preview_14 = CustomPreview(Geometry=srf_3, Material=ColourSwatch(SwatchColor=RGB(230, 174, 106)))  # disabled

# ---- group: 新表皮1
weave_4 = Weave(Pattern=[0, 1], Stream0=ln_15, Stream1=ln_16, NullGaps=False)
weave_5 = Weave(Pattern=[0, 1], Stream0=ln_16, Stream1=shift_7, NullGaps=False)
partition_8 = PartitionList(List=weave_4, Size=number_slider_25)
partition_9 = PartitionList(List=weave_5, Size=number_slider_26)
旋转角度_5 = Slider(36, range=0..100)
loft_5 = Loft(Curves=partition_9, Options={Adjust=False, Closed=False, LoftEnds=0, LoftSimp=0, LoftType=0, Rebuild=10, Refit=0.01})  # -> simplify(Loft)
loft_6 = Loft(Curves=partition_8, Options={Adjust=False, Closed=False, LoftEnds=0, LoftSimp=0, LoftType=0, Rebuild=10, Refit=0.01})
shift_8 = ShiftList(List=ln_15, Shift=1, Wrap=True)
trim_4 = TrimTree(Tree=loft_5, Depth=1)
trim_5 = TrimTree(Tree=loft_6, Depth=1)
neg_5 = Negative(Value=multiplication)
rotax_6 = RotateAxis(Geometry=trim_5, Angle=degrees(multiplication), Axis=ln_15)  # -> Geometry, Transform
rotax_7 = RotateAxis(Geometry=trim_4, Angle=degrees(neg_5), Axis=shift_8)  # -> Geometry, Transform
srf_4 = Surface(flatten([rotax_7.Geometry, rotax_6.Geometry]))
preview_15 = CustomPreview(Geometry=srf_4, Material=ColourSwatch(SwatchColor=RGB(230, 174, 106)))  # disabled

# ---- group: 遮阳
geo_5 = Geometry(flatten(srf_4))
geo_6 = Geometry(geo_5)
shade = HBShade(geo=geo_6, name="周围的遮挡物", attached=Toggle(True))  # -> report, shades; plug-in component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

# ---- group: 新表皮2 / 表皮支撑架
支撑架半径_2 = Slider(0.18, range=0..1)
mp_4 = MultiPipe(Curves=flatten(ln_16), NodeSize=支撑架半径_2, EndOffset=1, StrutSize=1, Segment=0, KinkAngle=0.6, CubeFit=0, Caps=1)
preview_16 = CustomPreview(Geometry=mp_4, Material=ColourSwatch(SwatchColor=RGB(148, 148, 148)))  # disabled

# ---- group: 新表皮1 / 表皮支撑架
支撑架半径_3 = Slider(0.18, range=0..1)
mp_5 = MultiPipe(Curves=flatten(shift_8), NodeSize=支撑架半径_3, EndOffset=1, StrutSize=1, Segment=0, KinkAngle=0.6, CubeFit=0, Caps=1)
swatch_9 = ColourSwatch(SwatchColor=RGB(148, 148, 148))  # disabled
preview_17 = CustomPreview(Geometry=mp_5, Material=swatch_9)  # disabled

# ---- group: 新表皮3
partition_10 = PartitionList(List=disc_6.Points, Size=Slider(2, range=0..10))
item_10 = ListItem(List=partition_10, Index=0, Wrap=True)  # -> Item, Item1
trim_6 = TrimTree(Tree=item_10.Item, Depth=1)
旋转角度_6 = Slider(24, range=0..100)
pline_5 = PolyLine(Vertices=trim_6, Closed=invert(False))
trim_7 = TrimTree(Tree=item_10.Item1, Depth=1)
explode_10 = Explode(Curve=pline_5, Recursive=True)  # -> Segments, Vertices
extr_5 = ExtrudePoint(Base=explode_10.Segments, Point=trim_7)
extr_6 = ExtrudePoint(Base=explode_10.Segments, Point=avr)
neg_6 = Negative(Value=multiplication)
rotax_8 = RotateAxis(Geometry=extr_5, Angle=degrees(multiplication), Axis=explode_10.Segments)  # -> Geometry, Transform
rotax_9 = RotateAxis(Geometry=extr_6, Angle=degrees(neg_6), Axis=explode_10.Segments)  # -> Geometry, Transform

半径_4 = Slider(0.24, range=0..10)
pipe_4 = Pipe(Curve=explode_10.Segments, Radius=半径_4, Caps=2)
preview_18 = CustomPreview(Geometry=pipe_4, Material=ColourSwatch(SwatchColor=RGB(161, 161, 161)))  # disabled

# ----
srf_5 = Surface(flatten([rotax_8.Geometry, rotax_9.Geometry]))

# ---- group: 新表皮3 (continued)
preview_19 = CustomPreview(Geometry=srf_5, Material=ColourSwatch(SwatchColor=RGB(230, 174, 106)))  # disabled

# ----
addshade = HBAddShade(hb_obj=bordershades.hb_objs, in_shades=flatten(shade.shades))  # -> hb_obj; plug-in component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
model = HBModel(rooms=flatten(addshade))  # -> report, model; plug-in component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
gridrooms = HBSensorGridFromRooms(rooms=model.model, grid_size=模型计算精细程度, dist_floor=Slider(0.4, range=0..10))  # -> grid, points, mesh; plug-in component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
assigngridsviews = HBAssignGridsAndViews(model=model.model, grids=flatten(gridrooms.grid))  # -> model; plug-in component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

# ---- group: 设置环境
panel = Panel("office")

# ----
searchschs = HBSearchSchedules(keywords=panel)  # -> schedules, type_limits; plug-in component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

# ---- group: 设置环境 (continued)
item_11 = ListItem(List=searchschs.schedules, Index=Slider(7, range=0..10), Wrap=True)

# ----
annualdaylight = HBAnnualDaylight(model=assigngridsviews, wea=wea, thresholds="-ut 2000", schedule=item_11, run_settings=recipesettings, run=toggle_2)  # -> report, results, DA, cDA, UDI, UDI_low, UDI_up; plug-in component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

最低亮度和最高亮度之间的百分比 = Number(annualdaylight.UDI)
高于自适应亮度的百分比 = Number(annualdaylight.DA)
高于最低亮度的百分比 = Number(annualdaylight.cDA)
低于舒适亮度的百分比 = Number(annualdaylight.UDI_low)
高于舒适亮度的百分比 = Number(annualdaylight.UDI_up)

equals = Equality(FirstNumber=高于舒适亮度的百分比, SecondNumber=Slider(0, range=0..100))  # -> Equality, Inequality
heatmap = LBSpatialHeatmap(values=高于舒适亮度的百分比, mesh=gridrooms.mesh, legend_par=legendpar)  # -> mesh, legend, title, colors, legend_par; plug-in component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
ma = MassAddition(Input=高于舒适亮度的百分比)  # -> Result, PartialResults
dispatch = Dispatch(List=高于舒适亮度的百分比, DispatchPattern=equals.Equality)  # -> ListA, ListB
lng_2 = ListLength(List=高于舒适亮度的百分比)
lng_3 = ListLength(List=dispatch.ListB)
panel_2 = Panel(ma.Result)
division = Division(A=lng_3, B=lng_2)
室内视线舒适度占比 = Panel(division)

# ==== cluster Cluster
A = ClusterInput()
multiplication = Multiplication(A=A, B=Slider(2, range=0..10))
R = ClusterOutput(multiplication)
