# Grasshopper definition ░ó▓╝╘·▒╚.gh (Grasshopper 1.0.7)
# plug-ins: Kangaroo2 Components

建筑高度 = Slider(234, range=0..1000)
number_slider = Slider(27, range=0..100)
range = Range(Domain=Domain(0, 1), Steps=number_slider)
pt = ConstructPoint(XCoordinate=Slider(151, range=0..1000), YCoordinate=0, ZCoordinate=Slider(93, range=0..100))
六边形半径 = Slider(32, range=0..100)
最小值 = Slider(39.44, range=0..100)
最大值 = Slider(54.04, range=0..100)
最小值_2 = Slider(26.95, range=0..100)
最大值_2 = Slider(40.2, range=0..100)
graph = GraphMapper(
    range,
    x0=0,
    x1=1,
    y0=0,
    y1=1,
    container_name="Bezier",
    cpx=[0, 0.3092947602, 0.6513981223, 1],
    cpy=[0, 0.2235748768, 0.2287192941, 0])
xz = XZPlane(Origin=pt)
polygon = Polygon(Plane=xz, Radius=六边形半径, Segments=6, FilletRadius=0)  # -> Polygon, Length
dom = ConstructDomain(DomainStart=最小值, DomainEnd=最大值)
dom_2 = ConstructDomain(DomainStart=最小值_2, DomainEnd=最大值_2)
bnd = Bounds(Numbers=graph)
disc = Discontinuity(Curve=polygon.Polygon, Level=1)  # -> Points, Parameters
range_2 = Range(Domain=建筑高度, Steps=number_slider)
remap = RemapNumbers(Value=graph, Source=bnd, Target=dom)  # -> Mapped, Clipped
remap_2 = RemapNumbers(Value=graph, Source=bnd, Target=dom_2)  # -> Mapped, Clipped
ln = Line(StartPoint=disc.Points, EndPoint=pt)
pt_2 = ConstructPoint(XCoordinate=0, YCoordinate=0, ZCoordinate=range_2)
srfsplit = SurfaceSplit(Surface=polygon.Polygon, Curves=ln)
xy = XYPlane(Origin=pt_2)
表皮和建筑间隙 = Slider(3.769, range=0..100)
u方向 = Slider(12, range=0..100)
v方向 = Slider(26, range=0..100)
ellipse = Ellipse(Plane=xy, Radius1=remap.Mapped, Radius2=remap_2.Mapped)  # -> Ellipse, Focus1, Focus2
crv = Curve(srfsplit)
loft = Loft(Curves=ellipse.Ellipse, Options={Adjust=False, Closed=False, LoftEnds=0, LoftSimp=0, LoftType=0, Rebuild=10, Refit=0.01})
cluster = Cluster(A=v方向)
cluster_2 = Cluster(A=u方向)
offset = OffsetSurface(Surface=loft, Distance=expr("-x", 表皮和建筑间隙), Retrim=True)
explode = Explode(Curve=crv, Recursive=True)  # -> Segments, Vertices
sdivide = DivideSurface(Surface=offset, UCount=cluster_2, VCount=cluster)  # -> Points, Normals, Parameters
series = Series(Start=0, Step=1, Count=expr("x+1", cluster_2))  # -> reverse(graft(Series))
series_2 = Series(Start=0, Step=1, Count=expr("x+1", cluster_2))  # -> graft(Series)
area = Area(Geometry=crv)  # -> Area, graft(Centroid)
disc_2 = Discontinuity(Curve=crv, Level=1)  # -> Points, Parameters
midpt = CurveMiddle(Curve=explode.Segments)
shift = ShiftList(List=sdivide.Points, Shift=1, Wrap=False)
ln_2 = Line(StartPoint=midpt, EndPoint=area.Centroid)
srf_cp = SurfaceClosestPoint(Point=area.Centroid, Surface=graft(srfsplit))  # -> Point, UVPoint, Distance
ln_3 = Line(StartPoint=disc_2.Points, EndPoint=area.Centroid)
shift_2 = ShiftList(List=shift, Shift=series, Wrap=True)
shift_3 = ShiftList(List=shift, Shift=series_2, Wrap=True)
开合距离 = Slider(3.09, range=0..10)
end = EndPoints(Curve=ln_2)  # -> Start, End
flip = FlipMatrix(Data=shift_2)
flip_2 = FlipMatrix(Data=shift_3)
evalsrf = EvaluateSurface(Surface=graft(srfsplit), Point=srf_cp.UVPoint)  # -> Point, Normal, UDirection, VDirection, Frame
number_slider_2 = Slider(2, range=0..10)
pt_3 = Point(area.Centroid)
pt_4 = Point(end.Start)
pline = PolyLine(Vertices=flip, Closed=False)  # -> flatten(Polyline)
pline_2 = PolyLine(Vertices=flip_2, Closed=False)  # -> flatten(Polyline)
骨架半径 = Slider(0.19, range=0..1)
end_2 = EndPoints(Curve=ln_3)  # -> Start, End
楼板间距 = Slider(13, range=0..100)
vec2pt = Vector2Pt(PointA=pt_4, PointB=area.Centroid, Unitize=False)  # -> Vector, Length
partition = PartitionList(List=pline, Size=number_slider_2)
partition_2 = PartitionList(List=pline_2, Size=number_slider_2)
pt_5 = Point(end_2.Start)
amp = Amplitude(Vector=vec2pt.Vector, Amplitude=开合距离)
divide = DivideDomain²(Domain=loft, UCount=Slider(26, range=0..100), VCount=Slider(50, range=0..100))
楼板 = Slider(0.2, range=0..1)
amp_2 = Amplitude(Vector=evalsrf.Normal, Amplitude=开合距离)
框架半径 = Slider(0.12, range=0..1)
move = Move(Geometry=pt_4, Motion=amp)  # -> Geometry, Transform
contour = Contour(Shape=loft, Point=Point(0, 0, 0), Direction=Vector(0, 0, 1), Distance=楼板间距)  # -> flatten(Contours)
item = ListItem(List=partition, Index=0, Wrap=True)
mp = MultiPipe(Curves=ln_3, NodeSize=骨架半径, EndOffset=1, StrutSize=1, Segment=0, KinkAngle=0.6, CubeFit=0, Caps=1)
item_2 = ListItem(List=partition_2, Index=0, Wrap=True)
shift_4 = ShiftList(List=pt_5, Shift=1, Wrap=True)
move_2 = Move(Geometry=pt_3, Motion=amp_2)  # -> Geometry, Transform
subsrf = Isotrim(Surface=loft, Domain=divide)
boundary = BoundarySurfaces(Edges=contour)
Z = UnitZ(Factor=楼板)
ln_4 = Line(StartPoint=move.Geometry, EndPoint=shift_4)  # -> simplify(Line)
explode_2 = Explode(Curve=item, Recursive=True)  # -> Segments, Vertices
ln_5 = Line(StartPoint=pt_5, EndPoint=move.Geometry)  # -> simplify(Line)
explode_3 = Explode(Curve=item_2, Recursive=True)  # -> Segments, Vertices
mp_2 = MultiPipe(Curves=subsrf, NodeSize=框架半径, EndOffset=1, StrutSize=1, Segment=0, KinkAngle=0.6, CubeFit=0, Caps=0)
flip_3 = FlipMatrix(Data=explode_3.Segments)
flip_4 = FlipMatrix(Data=explode_2.Segments)
extr = Extrude(Base=boundary, Direction=Z)
preview = CustomPreview(Geometry=mp, Material=ColourSwatch(SwatchColor=RGB(148, 148, 148)))
join = JoinCurves(Curves=[ln_4, ln_5], Preserve=False)
weave = Weave(Pattern=[0, 1], Stream0=flip_3, Stream1=flip_4, NullGaps=False)
preview_2 = CustomPreview(Geometry=extr, Material=ColourSwatch(SwatchColor=RGB(199, 199, 199)))
extr_2 = ExtrudePoint(Base=join, Point=move_2.Geometry)
item_3 = ListItem(List=ellipse.Ellipse, Index=0, Wrap=True)
midpt_2 = CurveMiddle(Curve=weave)
preview_3 = CustomPreview(Geometry=mp_2, Material=ColourSwatch(SwatchColor=RGB(255, 140, 140)))
preview_4 = CustomPreview(Geometry=subsrf, Material=ColourSwatch(SwatchColor=RGBA(191, 220, 255, 144)))
alongcrv = SortAlongCurve(Points=midpt_2, Curve=item_3)  # -> Points, Indices
preview_5 = CustomPreview(Geometry=extr_2, Material=ColourSwatch(SwatchColor=RGBA(134, 170, 189, 222)))
item_4 = ListItem(List=weave, Index=alongcrv.Indices, Wrap=True)  # -> simplify(Item)
number_slider_3 = Slider(2, range=0..10)
lng = ListLength(List=item_4)
series_3 = Series(Start=0, Step=1, Count=lng)  # -> simplify(Series)
dup = DuplicateData(Data=series_3, Number=number_slider_3, Order=False)
shift_5 = ShiftList(List=dup, Shift=1, Wrap=True)
item_5 = ListItem(List=item_4, Index=shift_5, Wrap=True)
partition_3 = PartitionList(List=item_5, Size=number_slider_3)
loft_2 = Loft(Curves=partition_3, Options={Adjust=False, Closed=False, LoftEnds=0, LoftSimp=0, LoftType=0, Rebuild=10, Refit=0.01})
trim = TrimTree(Tree=loft_2, Depth=1)
tstat = TreeStatistics(Tree=trim)  # -> Paths, Length, Count
dom_3 = ConstructDomain(DomainStart=Slider(3, range=0..100), DomainEnd=Slider(20, range=0..100))
subset = SubList(List=tstat.Paths, Domain=dom_3, Wrap=True)  # -> List, Index
branch = TreeBranch(Tree=trim, Path=subset.List, MaintainPaths=True)
dom_4 = ConstructDomain(DomainStart=Slider(4, range=0..100), DomainEnd=Slider(46, range=0..100))
subset_2 = SubList(List=branch, Domain=dom_4, Wrap=True)  # -> List, Index
crv_2 = Curve(subset_2.List)
explode_4 = Explode(Curve=crv_2, Recursive=True)  # -> Segments, Vertices
area_2 = Area(Geometry=crv_2)  # -> Area, graft(Centroid)
midpt_3 = CurveMiddle(Curve=explode_4.Segments)
disc_3 = Discontinuity(Curve=crv_2, Level=1)  # -> Points, Parameters
ln_6 = Line(StartPoint=midpt_3, EndPoint=area_2.Centroid)
srf_cp_2 = SurfaceClosestPoint(Point=area_2.Centroid, Surface=graft(subset_2.List))  # -> Point, UVPoint, Distance
ln_7 = Line(StartPoint=disc_3.Points, EndPoint=area_2.Centroid)
end_3 = EndPoints(Curve=ln_6)  # -> Start, End
end_4 = EndPoints(Curve=ln_7)  # -> Start, End
开合移动距离 = Slider(1.51, range=0..10)
evalsrf_2 = EvaluateSurface(Surface=graft(subset_2.List), Point=srf_cp_2.UVPoint)  # -> Point, Normal, UDirection, VDirection, Frame
pt_6 = Point(end_3.Start)
pt_7 = Point(end_4.Start)
vec2pt_2 = Vector2Pt(PointA=pt_6, PointB=area_2.Centroid, Unitize=False)  # -> Vector, Length
pt_8 = Point(area_2.Centroid)
shift_6 = ShiftList(List=pt_7, Shift=1, Wrap=True)
支撑架半径 = Slider(0.18, range=0..1)
amp_3 = Amplitude(Vector=vec2pt_2.Vector, Amplitude=开合移动距离)
amp_4 = Amplitude(Vector=evalsrf_2.Normal, Amplitude=开合移动距离)
move_3 = Move(Geometry=pt_6, Motion=amp_3)  # -> Geometry, Transform
move_4 = Move(Geometry=pt_8, Motion=amp_4)  # -> Geometry, Transform
mp_3 = MultiPipe(Curves=ln_7, NodeSize=支撑架半径, EndOffset=1, StrutSize=1, Segment=0, KinkAngle=0.6, CubeFit=0, Caps=1)
ln_8 = Line(StartPoint=move_3.Geometry, EndPoint=shift_6)  # -> simplify(Line)
ln_9 = Line(StartPoint=pt_7, EndPoint=move_3.Geometry)  # -> simplify(Line)
join_2 = JoinCurves(Curves=[ln_8, ln_9], Preserve=False)
extr_3 = ExtrudePoint(Base=join_2, Point=move_4.Geometry)
preview_6 = CustomPreview(Geometry=mp_3, Material=ColourSwatch(SwatchColor=RGB(148, 148, 148)))
preview_7 = CustomPreview(Geometry=extr_3, Material=ColourSwatch(SwatchColor=RGB(230, 174, 106)))

# ==== cluster Cluster
A = ClusterInput()
multiplication = Multiplication(A=A, B=Slider(2, range=0..10))
R = ClusterOutput(multiplication)
